% Simulink data dictionary MotorControlParameters.sldd

PMSM_Rs = Simulink.Parameter(0.02125)
PMSM_Ls = Simulink.Parameter(1.8e-5)
PMSM_psiPM = Simulink.Parameter(0.0021653734)
PMSM_p = Simulink.Parameter(14)
PMSM_J = Simulink.Parameter(0.0011)
PMSM_B = Simulink.Parameter(0.001)
Vdc = Simulink.Parameter(35)
Imax = Simulink.Parameter(15)
FOC_Kp = Simulink.Parameter(0.0565)
FOC_Ki = Simulink.Parameter(66.8)
SSC_phi_e = Simulink.Parameter(150)